# Grasshopper definition topo_sole.gh (Grasshopper 1.0.8)
# plug-ins: tOpos, Weaverbird, Kangaroo2 Components

brep = Brep(<brep referenced from the Rhino model>)
brep_2 = Brep(<brep referenced from the Rhino model>)
brep_3 = Brep(<brep referenced from the Rhino model>)
mesh = Mesh(brep)
# smoother mesh
mesh_2 = Mesh(<mesh referenced from the Rhino model>)
mesh_3 = Mesh(<mesh referenced from the Rhino model>)
negative = Negative(Value=Slider(1, range=0..5))
weaverbird_s_catmull_clark_subdivision = WeaverbirdsCatmullClarkSubdivision(MeshCurves=mesh_3, Level=Slider(0.89, range=0..1), SmoothNakedEdges=1)
deconstruct_mesh = DeconstructMesh(Mesh=mesh_2)  # -> Vertices, Faces, Colours, Normals
unit_z = UnitZ(Factor=negative)
boundary_domain = BoundaryDomain(
    DomainMesh=mesh,
    DensityValue=Slider(7.85, range=0..10),
    YoungModul=Slider(200, range=0..500),
    PoissonNumber=Slider(0.3, range=0..1))
construct_mesh = ConstructMesh(Vertices=deconstruct_mesh.Vertices, Faces=deconstruct_mesh.Faces)
volume_load = VolumeLoad(LoadMesh=brep_3, LoadVector=unit_z)
combine_clean = CombineClean(Meshes=construct_mesh)
analyser_parameters = AnalyserParameters(Iterations=Slider(44, range=1..100), Tolerance=0.001)
optimius_parameters = OptimiusParameters(
    OptimisationIteration=Slider(504, range=0..1000),
    VolumeFraction=Slider(0.75, range=0..1),
    Penalty=Domain(2, 3),
    Change=0.005,
    SensitivityFilterRadius=Domain(1.5, 1.5),
    DensityFilterType=0,
    GrayScaleFilter=False,
    HeavisideProjection=0,
    SensitivityFilterType=1)
boundary_conditions = BoundaryConditions(Load=volume_load, Support=brep_2)
resolution = Resolution(Size=Slider(0.92, range=0..3), sizeModeToggle=True)
smooth_mesh = SmoothMesh(Mesh=combine_clean, Strength=0.5, SkipNaked=True, Iterations=Slider(6, range=0..10))
model = Model(BoundaryDomain=boundary_domain, BoundaryCondition=boundary_conditions, ModelResolution=resolution, gpuModeToggle=False)  # -> Model, Performance
number_slider = Slider(0.8, range=0..1)
optimus = Optimus(
    Model=model.Model,
    AnalyserParameters=analyser_parameters,
    OptimusParameters=optimius_parameters,
    SubdivisionThreshold=0.5,
    Reset=Button(),
    Run=Toggle(False),
    optimisationPreviewMode=True,
    solverType=0)  # -> Model, Compliance, Performance
iso_mesh = IsoMesh(Model=optimus.Model, IsoValue=number_slider, Deflection=0)
voxel_mesh = VoxelMesh(Model=optimus.Model, Threshold=number_slider, asOneMeshMode=True, densityPreviewMode=True)  # disabled
mesh_4 = Mesh(iso_mesh)
deconstruct_mesh_2 = DeconstructMesh(Mesh=mesh_4)  # -> Vertices, Faces, Colours, Normals
construct_mesh_2 = ConstructMesh(Vertices=deconstruct_mesh_2.Vertices, Faces=deconstruct_mesh_2.Faces)
combine_clean_2 = CombineClean(Meshes=construct_mesh_2)
smooth_mesh_2 = SmoothMesh(Mesh=combine_clean_2, Strength=0.5, SkipNaked=True, Iterations=1)
